# Grasshopper definition gh-blender-pipe (basic).gh (Grasshopper 1.0.7)
# plug-ins: Portal, Bifocals

# ---- group: Input 1
# Portal GH == 0.3.0
# Portal Blender == 0.0.3
mesh_frame = Mesh(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)

# ----
srmesh = SerializeMesh(Mesh=mesh_frame)
# Pack data and metadata into a
#  single string before encoding
# as bytes for transmission.
pack = PackPayload(Data=srmesh, isBeautify=False)
# Blender Server
pipe = PipeSender(PipeName="testpipe", Bytes=pack, Send=Toggle(False))
