# Grasshopper definition gh-blender-websockets.gh (Grasshopper 1.0.7)
# plug-ins: Bifocals, Portal

trigger = Trigger(Interval=10, TimerInterval=10, Target=objmeta)  # disabled

# ---- group: Reference Geometry
# Portal GH == 0.4.0+
# Portal Blender == 0.1.0+
# Grasshopper -> Blender Websockets
mesh_frame = Mesh([<mesh referenced from the Rhino model> x2])

# ----
objmeta = ObjectMeta(Geometry=mesh_frame)  # -> Id, Layer, Material
srmeta = SerializeMetadata(Id=objmeta.Id, Layer=objmeta.Layer, Material=objmeta.Material)
srgeo = SerializeGeometry(Geometry=mesh_frame, Metadata=srmeta)
# Pack data and metadata into a
#  single string before encoding
# as bytes for transmission.
pack = PackPayload(Payloads=srgeo, isBeautify=False)
enb = BytesEncoder(Text=pack, Compress=Toggle(True))
# Blender Server
ws_client = WebSocketClient(HostIP="127.0.0.1", Port=Slider(6000, range=0..10000), Route="/", Bytes=enb, Send=Toggle(False))
