# Grasshopper definition portal-example.gh (Grasshopper 1.0.7)
# plug-ins: Portal.Gh, Bifocals

# ----
# UDP
panel = Panel("hey there from client")
number_slider = Slider(6000, range=0..10000)
enbytes = BytesEncoder(Text=panel)
udp = UDPSender(ServerIP="127.0.0.1", Port=number_slider, Bytes=enbytes, Send=Button())
udp_2 = UdpReceiver(Port=number_slider, Start=Toggle(False))
debytes = BytesDecoder(Bytes=udp_2)
panel_2 = Panel(debytes)

# ----
# WebSocket
panel_3 = Panel("hey there from ws ")
number_slider_2 = Slider(6001, range=0..10000)
enbytes_2 = BytesEncoder(Text=panel_3)
ws_client = WebSocketClient(HostIP="127.0.0.1", Port=number_slider_2, Route="/test", Bytes=enbytes_2, Send=Button())
ws_server = WebSocketServer(Port=number_slider_2, Route="/test", Start=Toggle(False))
debytes_2 = BytesDecoder(Bytes=ws_server)
panel_4 = Panel(debytes_2)

# ----
# File IO
panel_5 = Panel("hey there from grasshopper")
enb = BytesEncoder(Text=panel_5)
file = FileWriter(Bytes=enb, FilePath="D:\test.txt", Write=Button())
file_2 = FileReader(FilePath="D:\test.txt")
deb = BytesDecoder(Bytes=file_2)
panel_6 = Panel(deb)

# ----
# Pipe
panel_7 = Panel("hey there from pipe ")
button = Button()
enbytes_3 = BytesEncoder(Text=panel_7)
pipe = NamedPipeSender(ServerName=".", PipeName="TestPipe", Bytes=enbytes_3, Send=Toggle(False))
pipe_2 = NamedPipeReceiver(PipeName="TestPipe", Start=Toggle(False))
debytes_3 = BytesDecoder(Bytes=pipe_2)
panel_8 = Panel(debytes_3)

# ----
# Memory Mapped File
panel_9 = Panel("hey there from meory ")
enbytes_4 = BytesEncoder(Text=panel_9)
memory = SharedMemoryWriter(MemoryName="TestMemoryBlock", Bytes=enbytes_4, Write=Toggle(False))
memory_2 = SharedMemoryAutoReader(MemoryName="TestMemoryBlock", Interval=Slider(200, range=0..1000), Start=Toggle(False))
memory_3 = SharedMemoryReader(MemoryName="TestMemoryBlock", Start=Button())
debytes_4 = BytesDecoder(Bytes=memory_3)
debytes_5 = BytesDecoder(Bytes=memory_2)
panel_10 = Panel(debytes_4)
panel_11 = Panel(debytes_5)

# ----
# Mesh Serialization + compression
mesh = Mesh(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)
srmesh = SerializeMesh(Mesh=mesh)
enb_2 = BytesEncoder(Text=srmesh)
cb = CompressBytes(Bytes=enb_2)

# ----
# Point Serialization
pt = Point([Point(2.174324685, -5.670873841, 0), Point(6.052849799, -3.32025256, 0), Point(-0.3525931922, -0.9108657465, 0), Point(-4.936304691, -1.145927875, 0), Point(-7.463222568, -5.141984053, 0), Point(-1.057779577, -8.080260655, 0), Point(6.111615331, -8.315322783, 0), Point(0.9402485125, -5.494577245, 0), Point(-1.880497025, -2.438769579, 0), Point(2.585683409, 2.908893836, 0), Point(-5.347663415, 5.729639373, 0), Point(-9.872609382, 3.379018092, 0), Point(-13.16347918, -1.557286599, 0), Point(-16.10175578, -5.905935969, 0), Point(-11.75310641, -8.961743635, 0), Point(-5.700256607, -9.490633423, 0)])
srpt = SerializePoints(Points=pt)

# ----
# Mesh Serialization
mesh_2 = Mesh(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)
srmesh_2 = SerializeMesh(Mesh=mesh_2)

# ----
# Curve Serialization
crv = Curve(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)
srcrv = SerializeCurve(Curves=crv)

# ----
# Network Informations
info = NetworkInfo()  # -> Properties, LocalIP
panel_12 = Panel(info.Properties)

original = Panel(enb_2)
serialized_curve = Panel(srcrv)
serialized_points = Panel(srpt)
serialized_mesh = Panel(srmesh_2)
compressed = Panel(cb)

# ----
# Point Deserialization
dsrpt = DeserializePoints(JsonData=srpt)
deserialized_points = Panel(dsrpt)

# ----
# Mesh Deserialization + decompression
decb = DecompressBytes(Bytes=cb)
deb_2 = BytesDecoder(Bytes=decb)
dsrmesh = DeserializeMesh(JsonData=deb_2)
panel_13 = Panel(dsrmesh)

# ----
# Curve Deserialization
dsrcrv = DeserializeCurve(JsonData=srcrv)
deserialized_curve = Panel(dsrcrv)

# ----
# Mesh Deserialization
dsrmesh_2 = DeserializeMesh(JsonData=srmesh_2)
deserialized_mesh = Panel(dsrmesh_2)
