# Grasshopper definition websocket-example.gh (Grasshopper 1.0.7)
# plug-ins: NetworkGh

number_slider = Slider(6000, range=0..10000)
wspeer = WebSocketPeer(HostIP="localhost", Port=8765, Connect=Toggle(False))
panel = Panel(wspeer)
python = GhPythonScript(data=wspeer)  # -> value, timestamp
# ---------- python: Python ----------
import rhinoscriptsyntax as rs
import json

json_data = json.loads(data)
value = json_data["probability"]
timestamp = json_data["timestamp"]
# ---------- end python ----------
udp = UDPSender(ServerIP="127.0.0.1", Port=number_slider, Message="hey there from client 4", Send=Button())
info = NetworkInfo()  # -> Properties, LocalIP
panel_2 = Panel(info.Properties)
udp_2 = UdpReceiver(Port=number_slider, Start=Toggle(False))
websocket = WebSocketPeer(HostIP="127.0.0.1", Port=Slider(7613, range=0..10000), Connect=False)
panel_3 = Panel(udp_2)
np_client = NamedPipeClient(ServerName=".", PipeName="testpipe", Message="hey there from client 4", Timeout=Button())
np_server = NamedPipeServer(PipeName="testpipe", BufferSize=4096, Start=Toggle(False))
panel_4 = Panel(np_server)
